# Grasshopper definition NODEMaple Grasshopper.gh (Grasshopper 1.0.8)

nodemaple_materialdefinitions = Python3Script()  # -> categories, members_tree, metadata_tree, debug
# ---------- nodemaple_materialdefinitions: Python ----------
"""
NODEMaple Material Data — Levels 2 & 3 (tree output)
Queries grade lists ("allmembers") and property definitions ("metadata")
for all material categories in a single Maple process, and returns them
as Grasshopper data trees whose branches correspond to categories.

The branch order matches the order reported by NODEFunctions:-Materials(),
so a branch index is valid simultaneously in both trees.

Input:
  maple_version : Maple year, e.g. "2026" (ignored if MAPLE env var is set)

Output:
  members_tree  : tree, branch per category -> list of grade names
  metadata_tree : tree, branch per category -> list of property names
  categories    : ordered list of category names (branch keys, human-readable)
  debug         : raw Maple output; also shows SKIP|<category> lines

Requirements:
  - Maple 2023+ with NODE Library installed
  - NODE Toolbox loaded (automatically via PackageTools)
  - Valid Maple license available

GH1 compatibility: Uses Grasshopper.Kernel.Data.GH_Path
"""
import os
import subprocess
import Grasshopper
from Grasshopper.Kernel.Data import GH_Path

# ---------------------------------------------------------------------------
# Configuration
# ---------------------------------------------------------------------------
if os.environ.get("MAPLE"):
    MAPLE_ROOT = os.environ["MAPLE"]
else:
    MAPLE_ROOT = os.path.join(r"C:\Program Files", f"Maple {maple_version}")

MAPLE_PATH = os.path.join(MAPLE_ROOT, "bin.X86_64_WINDOWS", "cmaple.exe")


def run_maple_script(script, timeout=30):
    """Run a Maple script in a fresh cmaple process and return its output."""
    env = dict(os.environ)
    env["MAPLE"] = MAPLE_ROOT
    env["PATH"] = os.path.join(MAPLE_ROOT, "bin.X86_64_WINDOWS") + \
        os.pathsep + env.get("PATH", "")

    proc = subprocess.Popen(
        [MAPLE_PATH, "-q"],
        stdin=subprocess.PIPE, stdout=subprocess.PIPE,
        stderr=subprocess.STDOUT, text=True,
        cwd=os.path.join(MAPLE_ROOT, "bin.X86_64_WINDOWS"),
        env=env,
        creationflags=subprocess.CREATE_NO_WINDOW)

    out, _ = proc.communicate(input=script, timeout=timeout)
    return out


def query_material_data():
    """Fetch categories, grades and metadata in one Maple process.

    Emits: CAT|<category>          once per category, in order
           LIST|mem|<category>|<grade>
           LIST|meta|<category>|<property>
           SKIP|<category>         for unmapped categories

    NOTE: every Maple statement is terminated with ":" or ";".
    Omitting a terminator lets the parser swallow the following line
    (e.g. an inline if-expression), producing misleading syntax errors.
    """
    script_lines = [
        "kernelopts(printbytes=false):",
        "interface(prettyprint=0):",
        '# Category -> module mapping. Extend when new NODE material',
        '# packages are installed.',
        'nodetab := table(["steel"    = NODESteelMaterial,',
        '                  "timber"   = NODETimberMaterial,',
        '                  "concrete" = NODEConcreteMaterial]):',
        '# Categories are discovered at runtime, not hard-coded.',
        "cats := NODEFunctions:-Materials():",
        "known := [indices(nodetab, 'nolist')]:",
        "for c in cats do",
        '  printf("CAT|%s\\n", c):',
        "  if member(c, known) then",
        "    M := nodetab[c]:",
        '    for e in M:-Property("allmembers") do',
        '      printf("LIST|mem|%s|%s\\n", c, e):',
        "    end do:",
        '    for e in M:-Property("metadata") do',
        '      printf("LIST|meta|%s|%s\\n", c, e):',
        "    end do:",
        "  else",
        '    printf("SKIP|%s\\n", c):',
        "  end if:",
        "end do:",
        "quit:",
    ]
    return run_maple_script("\n".join(script_lines) + "\n")


# ---------------------------------------------------------------------------
# Main execution
# ---------------------------------------------------------------------------
raw = query_material_data()

categories = []                 # ordered category names (= branch keys)
members_by_cat = {}             # {"timber": [grades...]}
metadata_by_cat = {}            # {"timber": [properties...]}

for line in raw.splitlines():
    s = line.strip()
    if s.startswith("CAT|"):
        cat = s.split("|", 1)[1].strip()
        if cat:
            categories.append(cat)
            members_by_cat.setdefault(cat, [])
            metadata_by_cat.setdefault(cat, [])
    elif s.startswith("LIST|mem|"):
        # Parse grade entries
        parts = s.split("|", 3)
        if len(parts) == 4:
            _, kind, cat, entry = parts
            entry = entry.strip().strip('"')
            if entry:
                members_by_cat.setdefault(cat, []).append(entry)
    elif s.startswith("LIST|meta|"):
        # Parse property entries
        parts = s.split("|", 3)
        if len(parts) == 4:
            _, kind, cat, entry = parts
            entry = entry.strip().strip('"')
            if entry:
                metadata_by_cat.setdefault(cat, []).append(entry)

# Build the trees — GH1 recipe
members_tree = Grasshopper.DataTree[object]()
metadata_tree = Grasshopper.DataTree[object]()

for i, cat in enumerate(categories):
    path = GH_Path(i)
    members_tree.AddRange(members_by_cat.get(cat, []), path)
    metadata_tree.AddRange(metadata_by_cat.get(cat, []), path)

debug = raw
# ---------- end nodemaple_materialdefinitions ----------
panel = Panel(nodemaple_materialdefinitions.debug)
nodemaple_material_properties = Python3Script()  # -> out, categories, output_members, output_metadata, debug, probe, probe_sub
# ---------- nodemaple_material_properties: Python ----------
"""
NODEMaple Material Data — Levels 2 & 3 (tree output)
Queries grade lists ("allmembers") and property definitions ("metadata")
for all material categories in a single Maple process, and returns them
as Grasshopper data trees whose branches correspond to categories.

The branch order matches the order reported by NODEFunctions:-Materials(),
so a branch index is valid simultaneously in both trees.

Input:
  maple_version : Maple year, e.g. "2026" (ignored if MAPLE env var is set)

Output:
  members_tree  : tree, branch per category -> list of grade names
  metadata_tree : tree, branch per category -> list of property names
  categories    : ordered list of category names (branch keys, human-readable)
  debug         : raw Maple output; also shows SKIP|<category> lines
"""
import os
import subprocess
import Grasshopper
probe = [n for n in dir(Grasshopper) if not n.startswith("_")]
# also probe for a tree type:
probe_sub = []
try:
    probe_sub = [n for n in dir(Grasshopper.DataTree) if not n.startswith("_")]
except Exception as e:
    probe_sub = [f"DataTree probe failed: {e}"]
    
# ---------------------------------------------------------------------------
# Configuration
# ---------------------------------------------------------------------------
if os.environ.get("MAPLE"):
    MAPLE_ROOT = os.environ["MAPLE"]
else:
    MAPLE_ROOT = os.path.join(r"C:\Program Files", f"Maple {maple_version}")

MAPLE_PATH = os.path.join(MAPLE_ROOT, "bin.X86_64_WINDOWS", "cmaple.exe")


def run_maple_script(script, timeout=30):
    """Run a Maple script in a fresh cmaple process and return its output."""
    env = dict(os.environ)
    env["MAPLE"] = MAPLE_ROOT
    env["PATH"] = os.path.join(MAPLE_ROOT, "bin.X86_64_WINDOWS") + \
        os.pathsep + env.get("PATH", "")

    proc = subprocess.Popen(
        [MAPLE_PATH, "-q"],
        stdin=subprocess.PIPE, stdout=subprocess.PIPE,
        stderr=subprocess.STDOUT, text=True,
        cwd=os.path.join(MAPLE_ROOT, "bin.X86_64_WINDOWS"),
        env=env,
        creationflags=subprocess.CREATE_NO_WINDOW)

    out, _ = proc.communicate(input=script, timeout=timeout)
    return out


def query_material_data():
    """Fetch categories, grades and metadata in one Maple process.

    Emits: CAT|<category>          once per category, in order
           LIST|mem|<category>|<grade>
           LIST|meta|<category>|<property>
           SKIP|<category>         for unmapped categories

    NOTE: every Maple statement is terminated with ":" or ";".
    Omitting a terminator lets the parser swallow the following line
    (e.g. an inline if-expression), producing misleading syntax errors.
    """
    script_lines = [
        "kernelopts(printbytes=false):",
        "interface(prettyprint=0):",
        '# Category -> module mapping. Extend when new NODE material',
        '# packages are installed.',
        'nodetab := table(["steel"    = NODESteelMaterial,',
        '                  "timber"   = NODETimberMaterial,',
        '                  "concrete" = NODEConcreteMaterial]):',
        '# Categories are discovered at runtime, not hard-coded.',
        "cats := NODEFunctions:-Materials():",
        "known := [indices(nodetab, 'nolist')]:",
        "for c in cats do",
        '  printf("CAT|%s\\n", c):',
        "  if member(c, known) then",
        "    M := nodetab[c]:",
        '    for e in M:-Property("allmembers") do',
        '      printf("LIST|mem|%s|%s\\n", c, e):',
        "    end do:",
        '    for e in M:-Property("metadata") do',
        '      printf("LIST|meta|%s|%s\\n", c, e):',
        "    end do:",
        "  else",
        '    printf("SKIP|%s\\n", c):',
        "  end if:",
        "end do:",
        "quit:",
    ]
    return run_maple_script("\n".join(script_lines) + "\n")


# ---------------------------------------------------------------------------
# Main execution
# ---------------------------------------------------------------------------
raw = query_material_data()

categories = []                 # ordered category names (= branch keys)
members_by_cat = {}             # {"timber": [grades...]}
metadata_by_cat = {}            # {"timber": [properties...]}

for line in raw.splitlines():
    s = line.strip()
    if s.startswith("CAT|"):
        cat = s.split("|", 1)[1].strip()
        if cat:
            categories.append(cat)
            members_by_cat.setdefault(cat, [])
            metadata_by_cat.setdefault(cat, [])
    elif s.startswith("LIST|"):
        # LIST|<kind>|<category>|<entry>; entries contain "/" and ","
        parts = s.split("|", 3)
        if len(parts) == 4:
            _, kind, cat, entry = parts
            entry = entry.strip().strip('"')
            if not entry:
                continue
            if kind == "mem":
                members_by_cat.setdefault(cat, []).append(entry)
            elif kind == "meta":
                metadata_by_cat.setdefault(cat, []).append(entry)

# Instead of DataTree, return simple structures
output_members = {cat: members_by_cat.get(cat, []) for cat in categories}
output_metadata = {cat: metadata_by_cat.get(cat, []) for cat in categories}

debug = raw
# ---------- end nodemaple_material_properties ----------
panel_2 = Panel(nodemaple_materialdefinitions.metadata_tree)
nodemaple_material_property = Python3Script(list_key="allmembers")  # -> results, steel, timber, concrete, debug
#   port steel: Specific material qualities defined for chosen material
# ---------- nodemaple_material_property: Python ----------
"""
NODEMaple Material Lists — Levels 2 & 3 (generic)
Enumerates a named property list (e.g. "allmembers", "metadata") for all
material categories in a single Maple process.

Inputs:
  maple_version : Maple year, e.g. "2026" (ignored if MAPLE env var is set)
  list_key      : which list to query — "allmembers" (grade names) or
                  "metadata" (defined property names)

Outputs:
  results     : dict, e.g. {"timber": ["f_m,k", ...], ...}
  steel       : list of entries for steel
  timber      : list of entries for timber
  concrete    : list of entries for concrete
  debug       : raw Maple output; also shows SKIP|<category> lines
"""
import os
import subprocess

# ---------------------------------------------------------------------------
# Configuration
# ---------------------------------------------------------------------------
if os.environ.get("MAPLE"):
    MAPLE_ROOT = os.environ["MAPLE"]
else:
    MAPLE_ROOT = os.path.join(r"C:\Program Files", f"Maple {maple_version}")

MAPLE_EXE = os.path.join(MAPLE_ROOT, "bin.X86_64_WINDOWS", "cmaple.exe")

def run_maple_script(script, timeout=30):
    """Run a Maple script in a fresh cmaple process and return its output."""
    env = dict(os.environ)
    env["MAPLE"] = MAPLE_ROOT
    env["PATH"] = os.path.join(MAPLE_ROOT, "bin.X86_64_WINDOWS") + \
        os.pathsep + env.get("PATH", "")

    proc = subprocess.Popen(
        [MAPLE_EXE, "-q"],
        stdin=subprocess.PIPE, stdout=subprocess.PIPE,
        stderr=subprocess.STDOUT, text=True,
        cwd=os.path.join(MAPLE_ROOT, "bin.X86_64_WINDOWS"),
        env=env,
        creationflags=subprocess.CREATE_NO_WINDOW)

    out, _ = proc.communicate(input=script, timeout=timeout)
    return out

def get_property_lists(list_key):
    """Query M:-Property(list_key) for all NODE categories in one process.

    Emits one tagged line per entry:  LIST|<category>|<entry>
    Categories without a module mapping are reported as:  SKIP|<category>
    """
    script_lines = [
        "kernelopts(printbytes=false):",
        "interface(prettyprint=0):",
        "# Category -> module mapping. Extend when new NODE material",
        "# packages are installed.",
        'nodetab := table(["steel"    = NODESteelMaterial,',
        '                  "timber"   = NODETimberMaterial,',
        '                  "concrete" = NODEConcreteMaterial]):',
        "# Categories are discovered at runtime, not hard-coded.",
        "cats := NODEFunctions:-Materials():",
        "known := [indices(nodetab, 'nolist')]:",
        "for c in cats do",
        "  if member(c, known) then",
        "    M := nodetab[c]:",
        f"    lst := M:-Property(\"{list_key}\"):",
        "    for e in lst do",
        '      printf("LIST|%s|%s\\n", c, e)',
        "    end do:",
        "  else",
        '    printf("SKIP|%s\\n", c)',
        "  end if:",
        "end do:",
        "quit:",
    ]
    return run_maple_script("\n".join(script_lines) + "\n")

# ---------------------------------------------------------------------------
# Main execution
# ---------------------------------------------------------------------------
raw = get_property_lists(str(list_key).strip())

results = {}     # {"steel": [...], "timber": [...], "concrete": [...]}
for line in raw.splitlines():
    s = line.strip()
    if s.startswith("LIST|"):
        # Split into 3 parts max: prefix, category, entry.
        # Entries contain commas and underscores ("f_c,0,k"), so the
        # entry itself must never be split further.
        parts = s.split("|", 2)
        if len(parts) == 3:
            _, cat, entry = parts
            entry = entry.strip().strip('"')
            if entry:
                results.setdefault(cat, []).append(entry)

# Convenience outputs for direct wiring (avoids dict lookups on canvas).
steel = results.get("steel", [])
timber = results.get("timber", [])
concrete = results.get("concrete", [])

debug = raw
# ---------- end nodemaple_material_property ----------
nodemaple_material_property_2 = Python3Script(list_key="metadata")  # -> results, steel, timber, concrete, debug; same code as nodemaple_material_property
material = ValueList({"steel": 0, "timber": 1, "concrete": 2}, selected="steel")
panel_3 = Panel(nodemaple_material_properties.out)
panel_4 = Panel(nodemaple_material_properties.categories)
panel_5 = Panel(nodemaple_material_properties.probe_sub)
panel_6 = Panel(nodemaple_material_properties.output_metadata)
panel_7 = Panel(nodemaple_material_properties.probe)
panel_8 = Panel(nodemaple_material_property.results)
panel_9 = Panel(nodemaple_material_property_2.timber)
panel_10 = Panel(nodemaple_material_property.steel)
panel_11 = Panel(nodemaple_material_property.timber)
panel_12 = Panel(nodemaple_material_property.concrete)
panel_13 = Panel(nodemaple_materialdefinitions.members_tree)
panel_14 = Panel(nodemaple_material_properties.output_members)
panel_15 = Panel(nodemaple_material_properties.debug)
panel_16 = Panel(nodemaple_materialdefinitions.categories)
python_3_script = Python3Script(
    categories=nodemaple_materialdefinitions.categories,
    members_tree=nodemaple_materialdefinitions.members_tree,
    cat_index=Slider(0, range=0..2),
    grade_index=Slider(1, range=0..10))  # -> category, grade, count, debug; inputs categories: list, members_tree: tree
# ---------- python_3_script: Python ----------
"""
Grade Picker
Selects a grade name from the members tree by category index + item index.

Input:
  members_tree : tree from NODEMaple Material Definitions (Tree Access)
  categories   : list from the same component (List Access!)
  cat_index    : category index slider, 0 .. len(categories)-1
  grade_index  : grade index slider, 0 .. count-1

Output:
  grade    : selected grade name, e.g. "C24", "S 235", "B30"
  category : name of the chosen category (wire to property fetcher)
  count    : number of grades in the chosen category
  debug    : trace of the resolution for troubleshooting
"""
categories_list = [str(c) for c in categories] if categories else []

cat_idx = int(cat_index)
grade_idx = int(grade_index)

grade = None
category = None
count = 0

if 0 <= cat_idx < len(categories_list):
    category = categories_list[cat_idx]
    branch = members_tree.Branch(cat_idx)
    count = len(branch)

    # Clamp: sliders can't limit their own range (see README), so the
    # picker tolerates oversized indices instead of returning null.
    grade_idx = min(grade_idx, count - 1)

    if 0 <= grade_idx < count:
        grade = str(branch[grade_idx])
        debug = "Branch {%d} = %s -> item %d = %s" % (
            cat_idx, category, grade_idx, grade)
    else:
        debug = "Empty branch for category '%s'" % category
else:
    debug = "Warning: cat_index %d out of range (max %d)" % (
        cat_idx, len(categories_list) - 1)
# ---------- end python_3_script ----------
list_item = ListItem(List=nodemaple_material_property_2.steel, Index=Slider(1, range=0..16), Wrap=True)
panel_17 = Panel(python_3_script.debug)
panel_18 = Panel(python_3_script.category)
panel_19 = Panel(python_3_script.count)
panel_20 = Panel(python_3_script.grade)
list_item_2 = ListItem(List=nodemaple_material_property.steel, Index=Slider(14, range=0..40), Wrap=True)
list_item_3 = ListItem(List=panel_8, Index=Slider(0, range=0..2), Wrap=True)
nodemaple_material_properties_2 = Python3Script(category=python_3_script.category, grade=python_3_script.grade)  # -> values, prop_names, prop_values, prop_units, debug
# ---------- nodemaple_material_properties_2: Python ----------
"""
NODEMaple Batch Property Values — Level 4 (Batch)
Fetches ALL property values (with units) for a SINGLE material grade
in a single Maple process. Much faster than querying properties one-by-one.

Input:
  category     : material category, e.g. "timber", "steel", "concrete"
  grade        : specific grade name, e.g. "C24", "S 235", "B30"
  maple_version: Maple year, e.g. "2026" (ignored if MAPLE env var is set)

Output:
  values      : dict, e.g. {"f_m,k": (24.0, "Units:-Unit(N/mm^2)"), ...}
  prop_names  : ordered list of property names
  prop_values : ordered list of numeric values (float)
  prop_units  : ordered list of unit strings
  debug       : raw Maple output for troubleshooting
"""
import os
import subprocess

# ---------------------------------------------------------------------------
# Configuration
# ---------------------------------------------------------------------------
if os.environ.get("MAPLE"):
    MAPLE_ROOT = os.environ["MAPLE"]
else:
    MAPLE_ROOT = os.path.join(r"C:\Program Files", f"Maple {maple_version}")

MAPLE_PATH = os.path.join(MAPLE_ROOT, "bin.X86_64_WINDOWS", "cmaple.exe")

def run_maple_script(script, timeout=60):
    """Run a Maple script in a fresh cmaple process and return its output."""
    env = dict(os.environ)
    env["MAPLE"] = MAPLE_ROOT
    env["PATH"] = os.path.join(MAPLE_ROOT, "bin.X86_64_WINDOWS") + \
        os.pathsep + env.get("PATH", "")

    proc = subprocess.Popen(
        [MAPLE_PATH, "-q"],
        stdin=subprocess.PIPE, stdout=subprocess.PIPE,
        stderr=subprocess.STDOUT, text=True,
        cwd=os.path.join(MAPLE_ROOT, "bin.X86_64_WINDOWS"),
        env=env,
        creationflags=subprocess.CREATE_NO_WINDOW)

    out, _ = proc.communicate(input=script, timeout=timeout)
    return out

def category_to_module(category):
    """Map a material category to its Maple module name."""
    return "NODE" + category.capitalize() + "Material"

# ---------------------------------------------------------------------------
# Main execution
# ---------------------------------------------------------------------------
category = str(category).strip().lower()
module_name = category_to_module(category)
grade = str(grade).strip()

# Single Maple script:
#   1. fetch the property-name list via Property("metadata")  (no grade!)
#   2. fetch each property value via Property(grade, pname)
# Every statement terminates with ":" — see Level 2/3 lesson.
script = (
    "kernelopts(printbytes=false):\n"
    "interface(prettyprint=0):\n"
    f'props := {module_name}:-Property("metadata"):\n'
    "n := numelems(props):\n"
    'printf("COUNT|%d\\n", n):\n'
    "for i from 1 to n do\n"
    "  pname := props[i]:\n"
    f'  pval := {module_name}:-Property("{grade}", pname):\n'
    "  q := Units:-Split(pval):\n"
    '  printf("PROPNAM|%a\\n", pname):\n'
    '  printf("PROPVAL|%a\\n", evalf(q[1])):\n'
    '  printf("PROPUNT|%a\\n", q[2]):\n'
    "end do:\n"
    "quit:\n"
)

raw = run_maple_script(script)

# Parse: one NAME|VAL|UNIT triplet per property
values = {}
prop_names = []
prop_values = []
prop_units = []

cur_name = None
cur_val = None

for line in raw.splitlines():
    s = line.strip()
    if s.startswith("PROPNAM|"):
        cur_name = s.split("|", 1)[1].strip()
    elif s.startswith("PROPVAL|") and cur_name is not None:
        try:
            cur_val = float(s.split("|", 1)[1])
        except ValueError:
            cur_val = None
    elif s.startswith("PROPUNT|") and cur_name is not None:
        unit = s.split("|", 1)[1].strip()
        # Complete triplet -> store
        prop_names.append(cur_name)
        prop_values.append(cur_val)
        prop_units.append(unit)
        values[cur_name] = (cur_val, unit)
        cur_name = None      # reset for the next triplet
        cur_val = None

debug = raw
# ---------- end nodemaple_material_properties_2 ----------
panel_21 = Panel(list_item_3)
panel_22 = Panel(list_item_2)
panel_23 = Panel(list_item)
panel_24 = Panel(nodemaple_material_properties_2.prop_units)
panel_25 = Panel(nodemaple_material_properties_2.debug)
panel_26 = Panel(nodemaple_material_properties_2.values)
panel_27 = Panel(nodemaple_material_properties_2.prop_values)
panel_28 = Panel(nodemaple_material_properties_2.prop_names)
material_property = Python3Script(category=panel_21, grade=panel_22, prop=panel_23)  # -> value, unit, debug
# ---------- material_property: Python ----------
"""
NODEMaple Single Property — Level 4
Fetches one property value (with units) for a single material grade
from the NODE Maple library.

Input:
  category     : material category, e.g. "timber", "steel", "concrete"
  grade        : specific grade name, e.g. "C24", "S 235", "B30"
  prop         : property name from metadata list, e.g. "f_m,k"
  maple_version: Maple year, e.g. "2026" (ignored if MAPLE env var is set)

Output:
  value : numeric property value as float, e.g. 24.0
  unit  : unit string, e.g. "Units:-Unit(N/mm^2)"
  debug : raw Maple output for troubleshooting
"""
import os
import subprocess

# ---------------------------------------------------------------------------
# Configuration
# ---------------------------------------------------------------------------
if os.environ.get("MAPLE"):
    MAPLE_ROOT = os.environ["MAPLE"]
else:
    MAPLE_ROOT = os.path.join(r"C:\Program Files", f"Maple {maple_version}")

MAPLE_PATH = os.path.join(MAPLE_ROOT, "bin.X86_64_WINDOWS", "cmaple.exe")

def run_maple_script(script, timeout=20):
    """Run a Maple script in a fresh cmaple process and return its output."""
    env = dict(os.environ)
    env["MAPLE"] = MAPLE_ROOT
    env["PATH"] = os.path.join(MAPLE_ROOT, "bin.X86_64_WINDOWS") + \
        os.pathsep + env.get("PATH", "")

    proc = subprocess.Popen(
        [MAPLE_PATH, "-q"],
        stdin=subprocess.PIPE, stdout=subprocess.PIPE,
        stderr=subprocess.STDOUT, text=True,
        cwd=os.path.join(MAPLE_ROOT, "bin.X86_64_WINDOWS"),
        env=env,
        creationflags=subprocess.CREATE_NO_WINDOW)

    out, _ = proc.communicate(input=script, timeout=timeout)
    return out

def category_to_module(category):
    """Map a material category to its Maple module name.

    "timber" -> "NODETimberMaterial", "steel" -> "NODESteelMaterial", ...
    """
    return "NODE" + category.capitalize() + "Material"

# ---------------------------------------------------------------------------
# Main execution
# ---------------------------------------------------------------------------
category = str(category).strip().lower()
module_name = category_to_module(category)
grade = str(grade).strip()
prop = str(prop).strip()

script = (
    "kernelopts(printbytes=false):\n"
    "interface(prettyprint=0):\n"
    f'p := {module_name}:-Property("{grade}", "{prop}"):\n'
    "q := Units:-Split(p):\n"
    'printf("VALUE=%a\\n", evalf(q[1])):\n'
    'printf("UNIT=%a\\n", q[2]):\n'
    "quit:\n"
)

raw = run_maple_script(script)

value = None
unit = None

for line in raw.splitlines():
    s = line.strip()
    if s.startswith("VALUE="):
        try:
            value = float(s.split("=", 1)[1])
        except ValueError:
            pass
    elif s.startswith("UNIT="):
        unit = s.split("=", 1)[1]

debug = raw
# ---------- end material_property ----------
panel_29 = Panel(material_property.unit)
panel_30 = Panel(material_property.value)
panel_31 = Panel(material_property.debug)
