# Grasshopper definition NODEMaple Grasshopper.gh (Grasshopper 1.0.9)

nodemaple_steelprofiles = NODEMapleSteelProfiles()  # -> families, sections_tree, metadata_tree, debug
# ---------- nodemaple_steelprofiles: Python ----------
"""
NODEMaple Section Definitions
Discovers steel profile families and, per family, the section list and
the section property names — in a single Maple process.

Hierarchy (one level deeper than materials):
  NODESteelProfiles:-Property("allmembers")       -> families
  NODESteelProfiles_<family>:-Property(...)       -> sections, metadata

Module names are constructed dynamically (NODESteelProfiles_<family>),
so new families are picked up automatically — no static lookup table.

Input:
  maple_version : Maple year, e.g. "2026" (ignored if MAPLE env var is set)

Output:
  families      : ordered list of family names (branch keys)
  sections_tree : tree, branch per family -> section names
  metadata_tree : tree, branch per family -> section property names
  debug         : raw Maple output; SKIP|<family> lines report failures
"""
import os
import subprocess
import Grasshopper
from Grasshopper.Kernel.Data import GH_Path

# ---------------------------------------------------------------------------
# Configuration
# ---------------------------------------------------------------------------
if os.environ.get("MAPLE"):
    MAPLE_ROOT = os.environ["MAPLE"]
else:
    MAPLE_ROOT = os.path.join(r"C:\Program Files", f"Maple {maple_version}")

MAPLE_PATH = os.path.join(MAPLE_ROOT, "bin.X86_64_WINDOWS", "cmaple.exe")

def run_maple_script(script, timeout=60):
    """Run a Maple script in a fresh cmaple process and return its output."""
    env = dict(os.environ)
    env["MAPLE"] = MAPLE_ROOT
    env["PATH"] = os.path.join(MAPLE_ROOT, "bin.X86_64_WINDOWS") + \
        os.pathsep + env.get("PATH", "")

    proc = subprocess.Popen(
        [MAPLE_PATH, "-q"],
        stdin=subprocess.PIPE, stdout=subprocess.PIPE,
        stderr=subprocess.STDOUT, text=True,
        cwd=os.path.join(MAPLE_ROOT, "bin.X86_64_WINDOWS"),
        env=env,
        creationflags=subprocess.CREATE_NO_WINDOW)

    out, _ = proc.communicate(input=script, timeout=timeout)
    return out

def query_section_data():
    """Fetch families, sections and metadata in one Maple process.

    Emits: CAT|<family>            once per family, in order
           LIST|sec|<family>|<section name>
           LIST|meta|<family>|<property name>
           SKIP|<family>           if the family module cannot be resolved

    Module resolution is dynamic: parse(cat("NODESteelProfiles_", f)).
    If that fails to trigger the toolbox autoloader for a family,
    the try/catch reports it as SKIP instead of aborting the run.
    """
    script_lines = [
        "kernelopts(printbytes=false):",
        "interface(prettyprint=0):",
        'fams := NODESteelProfiles:-Property("allmembers"):',
        "for f in fams do",
        '  printf("CAT|%s\\n", f):',
        "  try",
        '    M := parse(cat("NODESteelProfiles_", f)):',
        '    for e in M:-Property("allmembers") do',
        '      printf("LIST|sec|%s|%s\\n", f, e):',
        "    end do:",
        '    for e in M:-Property("metadata") do',
        '      printf("LIST|meta|%s|%s\\n", f, e):',
        "    end do:",
        "  catch:",
        '    printf("SKIP|%s\\n", f):',
        "  end try:",
        "end do:",
        "quit:",
    ]
    return run_maple_script("\n".join(script_lines) + "\n")

# ---------------------------------------------------------------------------
# Main execution
# ---------------------------------------------------------------------------
raw = query_section_data()

families = []                 # ordered family names (= branch keys)
sections_by_fam = {}          # {"I": ["IPE 200", ...]}
metadata_by_fam = {}          # {"I": ["A_x", ...]}

for line in raw.splitlines():
    s = line.strip()
    if s.startswith("CAT|"):
        fam = s.split("|", 1)[1].strip()
        if fam:
            families.append(fam)
            sections_by_fam.setdefault(fam, [])
            metadata_by_fam.setdefault(fam, [])
    elif s.startswith("LIST|sec|") or s.startswith("LIST|meta|"):
        parts = s.split("|", 3)
        if len(parts) == 4:
            _, kind, fam, entry = parts
            entry = entry.strip().strip('"')
            if not entry:
                continue
            if kind == "sec":
                sections_by_fam.setdefault(fam, []).append(entry)
            else:
                metadata_by_fam.setdefault(fam, []).append(entry)

# Build the trees — branch index i corresponds to families[i]
sections_tree = Grasshopper.DataTree[object]()
metadata_tree = Grasshopper.DataTree[object]()

for i, fam in enumerate(families):
    path = GH_Path(i)
    sections_tree.AddRange(sections_by_fam.get(fam, []), path)
    metadata_tree.AddRange(metadata_by_fam.get(fam, []), path)

debug = raw
# ---------- end nodemaple_steelprofiles ----------
nodemaple_materialdefinitions = NODEMapleMaterialDefinitions()  # -> categories, members_tree, metadata_tree, debug
# ---------- nodemaple_materialdefinitions: Python ----------
"""
NODEMaple Material Data — Levels 2 & 3 (tree output)
Queries grade lists ("allmembers") and property definitions ("metadata")
for all material categories in a single Maple process, and returns them
as Grasshopper data trees whose branches correspond to categories.

For steel: grades include standard code (e.g. "S 275 H@NS-EN 10210-1")
to disambiguate grades that appear under multiple standards.

The branch order matches the order reported by NODEFunctions:-Materials(),
so a branch index is valid simultaneously in both trees.

Input:
  maple_version : Maple year, e.g. "2026" (ignored if MAPLE env var is set)

Output:
  members_tree  : tree, branch per category -> list of grade names
  metadata_tree : tree, branch per category -> list of property names
  categories    : ordered list of category names (branch keys, human-readable)
  debug         : raw Maple output; also shows SKIP|<category> lines
"""
import os
import subprocess
import Grasshopper
from Grasshopper.Kernel.Data import GH_Path

# ---------------------------------------------------------------------------
# Configuration
# ---------------------------------------------------------------------------
if os.environ.get("MAPLE"):
    MAPLE_ROOT = os.environ["MAPLE"]
else:
    MAPLE_ROOT = os.path.join(r"C:\Program Files", f"Maple {maple_version}")

MAPLE_PATH = os.path.join(MAPLE_ROOT, "bin.X86_64_WINDOWS", "cmaple.exe")

def run_maple_script(script, timeout=30):
    """Run a Maple script in a fresh cmaple process and return its output."""
    env = dict(os.environ)
    env["MAPLE"] = MAPLE_ROOT
    env["PATH"] = os.path.join(MAPLE_ROOT, "bin.X86_64_WINDOWS") + \
        os.pathsep + env.get("PATH", "")

    proc = subprocess.Popen(
        [MAPLE_PATH, "-q"],
        stdin=subprocess.PIPE, stdout=subprocess.PIPE,
        stderr=subprocess.STDOUT, text=True,
        cwd=os.path.join(MAPLE_ROOT, "bin.X86_64_WINDOWS"),
        env=env,
        creationflags=subprocess.CREATE_NO_WINDOW)

    out, _ = proc.communicate(input=script, timeout=timeout)
    return out

def query_material_data():
    """Fetch categories, grades and metadata in one Maple process.

    For STEEL: outputs CODE@GRADE combinations to disambiguate
    grades appearing under multiple standards (e.g. "S 275 H@NS-EN 10210-1").
    
    Emits: CAT|<category>          once per category, in order
           LIST|mem|<category>|<grade>
           LIST|meta|<category>|<property>
           SKIP|<category>         for unmapped categories

    NOTE: every Maple statement is terminated with ":" or ";".
    Omitting a terminator lets the parser swallow the following line
    (e.g. an inline if-expression), producing misleading syntax errors.
    """
    script_lines = [
        "kernelopts(printbytes=false):",
        "interface(prettyprint=0):",
        '# Category -> module mapping',
        'nodetab := table(["steel"    = NODESteelMaterial,',
        '                  "timber"   = NODETimberMaterial,',
        '                  "concrete" = NODEConcreteMaterial]):',
        '# Categories are discovered at runtime',
        "cats := NODEFunctions:-Materials():",
        "known := [indices(nodetab, 'nolist')]:",
        "for c in cats do",
        '  printf("CAT|%s\\n", c):',
        "  if member(c, known) then",
        "    M := nodetab[c]:",
        '# Steel: special handling for code-grade pairs',
        '  if c = "steel" then',
        '# First get all codes',
        '    codes := M:-Property("allcodes"):',
        '    for code in codes do',
        '# Then grades of this code',
        '      for g in M:-Property(code,"allmembers") do',
        '# Composite grade name: grade@code',
        '        fullname := cat(g,"@",code):',
        '        printf("LIST|mem|%s|%s\\n", c, fullname):',
        "      end do:",
        "    end do:",
        "  else:",
        '# Non-steel: simple grade list',
        '    for e in M:-Property("allmembers") do',
        '      printf("LIST|mem|%s|%s\\n", c, e):',
        "    end do:",
        "  end if:",
        '# Metadata is always simple list',
        '    for e in M:-Property("metadata") do',
        '      printf("LIST|meta|%s|%s\\n", c, e):',
        "    end do:",
        "  else",
        '    printf("SKIP|%s\\n", c):',
        "  end if:",
        "end do:",
        "quit:",
    ]
    return run_maple_script("\n".join(script_lines) + "\n")

# ---------------------------------------------------------------------------
# Main execution
# ---------------------------------------------------------------------------
raw = query_material_data()

categories = []                 # ordered category names (= branch keys)
members_by_cat = {}             # {"timber": [grades...]}
metadata_by_cat = {}            # {"timber": [properties...]}

for line in raw.splitlines():
    s = line.strip()
    if s.startswith("CAT|"):
        cat = s.split("|", 1)[1].strip()
        if cat:
            categories.append(cat)
            members_by_cat.setdefault(cat, [])
            metadata_by_cat.setdefault(cat, [])
    elif s.startswith("LIST|mem|"):
        parts = s.split("|", 3)
        if len(parts) == 4:
            _, kind, cat, entry = parts
            entry = entry.strip().strip('"')
            if entry:
                members_by_cat.setdefault(cat, []).append(entry)
    elif s.startswith("LIST|meta|"):
        parts = s.split("|", 3)
        if len(parts) == 4:
            _, kind, cat, entry = parts
            entry = entry.strip().strip('"')
            if entry:
                metadata_by_cat.setdefault(cat, []).append(entry)

# Build the trees — GH1 recipe
members_tree = Grasshopper.DataTree[object]()
metadata_tree = Grasshopper.DataTree[object]()

for i, cat in enumerate(categories):
    path = GH_Path(i)
    members_tree.AddRange(members_by_cat.get(cat, []), path)
    metadata_tree.AddRange(metadata_by_cat.get(cat, []), path)

debug = raw
# ---------- end nodemaple_materialdefinitions ----------
vl_material = ValueList({"steel": 0, "timber": 1, "concrete": 2}, selected="concrete")
panel = Panel(nodemaple_steelprofiles.families)
panel_2 = Panel(nodemaple_steelprofiles.sections_tree)
tree_branch = TreeBranch(Tree=nodemaple_materialdefinitions.members_tree, Path=vl_material, MaintainPaths=True)
tree_branch_2 = TreeBranch(Tree=nodemaple_materialdefinitions.metadata_tree, Path=vl_material, MaintainPaths=True)
panel_3 = Panel(tree_branch)
list_item = ListItem(List=nodemaple_materialdefinitions.categories, Index=vl_material, Wrap=True)
panel_4 = Panel(tree_branch_2)
vl_profiletype = ValueList({"CF_RHS": 0, "CF_SHS": 1, "H": 2, "HF_RHS": 3, "HF_SHS": 4, "I": 5}, selected="CF_RHS")
panel_5 = Panel(list_item)
tree_branch_3 = TreeBranch(Tree=panel_2, Path=vl_profiletype, MaintainPaths=True)

# ---- group: Value List Definition Steel Profiles
populate_valuelist = PopulateValueList(list_name="VL_profiletype", names=nodemaple_steelprofiles.families)  # -> out, a; inputs list_name: String, names: list of String, values: list of String
#   port list_name: name of value list component to be modified
#   port names: list with values
#   port values: export values for chosen items, if empty, index values are returned
# ---------- populate_valuelist: Python ----------
import Grasshopper as gh
from Grasshopper.Kernel.Special import GH_ValueListItem

doc = ghenv.Component.OnPingDocument()

# list_name og names må alltid være definert
if doc and list_name and names:
    
    # 1. Finn Value List på lerretet basert på Nickname
    target_list = None
    for obj in doc.Objects:
        if isinstance(obj, gh.Kernel.Special.GH_ValueList) and obj.NickName == list_name:
            target_list = obj
            break

    if target_list:
        formatted_items = []
        has_custom_values = bool(values and len(values) > 0)

        for i, name in enumerate(names):
            n = str(name).strip()
            
            if has_custom_values and i < len(values):
                # Bruk oppgitt verdi fra 'values'
                val_raw = str(values[i]).strip()
                try:
                    float(val_raw)
                    expr = val_raw
                except ValueError:
                    expr = '"{}"'.format(val_raw)
            else:
                # Fallback: Bruk listenummer / indeks som heltall
                expr = str(i)

            formatted_items.append((n, expr))

        # Kontroller gjeldende tilstand for å unngå unødvendig oppdatering
        current_state = [(item.Name, item.Expression) for item in target_list.ListItems]
        
        if current_state != formatted_items:
            def update_callback(d):
                target_list.ListItems.Clear()
                for n, expr in formatted_items:
                    target_list.ListItems.Add(GH_ValueListItem(n, expr))
                
                target_list.Attributes.ExpireLayout()
                target_list.ExpireSolution(False)

            doc.ScheduleSolution(1, gh.Kernel.GH_Document.GH_ScheduleDelegate(update_callback))
# ---------- end populate_valuelist ----------
populate_valuelist_2 = PopulateValueList(list_name="VL_profile", names=tree_branch_3, values=tree_branch_3)  # -> out, a; inputs list_name: String, names: list of String, values: list of String; same code as populate_valuelist

# ----
vl_grade = ValueList({"B10", "B20", "B25", "B30", "B35", "B45", "B55", "B65", "B75", "B85", "B95", "LB12", "LB20", "LB25", "LB30", "LB35", "LB45", "LB55", "LB65", "LB75"}, selected="B35")
vl_profile = ValueList({"RHS 40 x 20 x 2", "RHS 40 x 20 x 2.5", "RHS 40 x 20 x 3", "RHS 50 x 30 x 2", "RHS 50 x 30 x 2.5", "RHS 50 x 30 x 3", "RHS 50 x 30 x 4", "RHS 60 x 40 x 2", "RHS 60 x 40 x 2.5", "RHS 60 x 40 x 3"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}, selected="RHS 40 x 20 x 2")
list_item_2 = ListItem(List=nodemaple_steelprofiles.families, Index=vl_profiletype, Wrap=True)  # -> simplify(Item)
tree_branch_4 = TreeBranch(Tree=nodemaple_steelprofiles.metadata_tree, Path=vl_profiletype, MaintainPaths=True)
nodemaple_materialproperties = NODEMapleMaterialProperties(category=panel_5, grade=vl_grade, prop_names=panel_4)  # -> values, units, texts, table, debug; inputs prop_names: list
# ---------- nodemaple_materialproperties: Python ----------
"""
NODEMaple Retrieve All Properties
Fetches ALL property values for a SINGLE material grade in one Maple process.

Workflow:
  material -> grade -> variables -> values

Accepts the variable list from the metadata branch (or any list of
property names). Returns parallel lists, so values[i] / units[i] /
texts[i] all belong to names_in[i].

Steel: use the composite grade "S 275 H@NS-EN 10210-1" to select the
standard; the "@code" suffix is split off and passed as the 3rd
Property argument.

Input:
  category      : "steel", "timber", "concrete"
  grade         : e.g. "C24", "S 275 H@NS-EN 10210-1"
  prop_names    : list of property names to fetch (List Access!)
  maple_version : Maple year, e.g. "2026" (ignored if MAPLE env var is set)

Output:
  names_in : echo of the requested property names (ordered)
  values   : parallel list of numeric values (None for text properties)
  units    : parallel list of unit strings ("" where none)
  texts    : parallel list of text values (None for numeric properties)
  table    : display list, "name = value unit" one line per property
  debug    : raw Maple output, preceded by a send/receive summary

NOTE: the Maple<->Python protocol is ASCII-only ("|" as field separator).
Non-ASCII separators do not survive the cmaple stdin/stdout round trip.
"""
import os
import subprocess

# ---------------------------------------------------------------------------
# Configuration
# ---------------------------------------------------------------------------
if os.environ.get("MAPLE"):
    MAPLE_ROOT = os.environ["MAPLE"]
else:
    MAPLE_ROOT = os.path.join(r"C:\Program Files", f"Maple {maple_version}")

MAPLE_PATH = os.path.join(MAPLE_ROOT, "bin.X86_64_WINDOWS", "cmaple.exe")

def run_maple_script(script, timeout=60):
    """Run a Maple script in a fresh cmaple process and return its output."""
    env = dict(os.environ)
    env["MAPLE"] = MAPLE_ROOT
    env["PATH"] = os.path.join(MAPLE_ROOT, "bin.X86_64_WINDOWS") + \
        os.pathsep + env.get("PATH", "")

    proc = subprocess.Popen(
        [MAPLE_PATH, "-q"],
        stdin=subprocess.PIPE, stdout=subprocess.PIPE,
        stderr=subprocess.STDOUT, text=True,
        cwd=os.path.join(MAPLE_ROOT, "bin.X86_64_WINDOWS"),
        env=env,
        creationflags=subprocess.CREATE_NO_WINDOW)

    out, _ = proc.communicate(input=script, timeout=timeout)
    return out

def category_to_module(category):
    """Map a material category to its Maple module name."""
    return "NODE" + category.capitalize() + "Material"

# ---------------------------------------------------------------------------
# Main execution
# ---------------------------------------------------------------------------
category = str(category).strip().lower()
module_name = category_to_module(category)
grade = str(grade).strip()

# Normalise the incoming names: trim whitespace and any surrounding quotes.
prop_list = []
for p in (prop_names if prop_names else []):
    s = str(p).strip().strip('"').strip("'")
    if s:
        prop_list.append(s)

# Steel: split composite grade "S 275 H@NS-EN 10210-1" into grade + code.
if "@" in grade:
    g, code = grade.rsplit("@", 1)
    query_line = f'pval := {module_name}:-Property("{g}", "{code}", pname):'
else:
    g = grade
    query_line = f'pval := {module_name}:-Property("{g}", pname):'

# Pass the property list into Maple as a quoted list literal.
# Names contain commas ("f_m,k"), so every element MUST be quoted.
maple_list = "[" + ", ".join('"%s"' % p for p in prop_list) + "]"

# One record per property, fixed field layout:
#   REC|<name>|num|<value>|<unit>
#   REC|<name>|text|<string>
#   REC|<name>|skip|
# "|" is ASCII and proven to survive the pipe. Neither property names
# nor unit expressions contain it.
script = (
    f'kernelopts(printbytes=false):\n'
    f'interface(prettyprint=0):\n'
    f'props := {maple_list}:\n'
    f'for i from 1 to numelems(props) do\n'
    f'  pname := props[i]:\n'
    f'  {query_line}\n'
    f'  if type(pval, string) then\n'
    f'    printf("REC|%s|text|%s\\n", pname, pval):\n'
    f'  else\n'
    f'    try\n'
    f'      q := Units:-Split(pval):\n'
    f'      printf("REC|%s|num|%a|%a\\n", pname, evalf(q[1]), q[2]):\n'
    f'    catch:\n'
    f'      try\n'
    f'        printf("REC|%s|num|%a|\\n", pname, evalf(pval)):\n'
    f'      catch:\n'
    f'        printf("REC|%s|skip|\\n", pname):\n'
    f'      end try:\n'
    f'    end try:\n'
    f'  end if:\n'
    f'end do:\n'
    f'quit:\n'
)

raw = run_maple_script(script)

# ---------------------------------------------------------------------------
# Parse results — output order follows the requested prop_list
# ---------------------------------------------------------------------------
names_in = list(prop_list)
values = []
units = []
texts = []
table = []

recs = {}          # {name: (kind, payload, unit)}
for line in raw.splitlines():
    s = line.strip()
    if not s.startswith("REC|"):
        continue
    parts = s.split("|")
    if len(parts) < 3:
        continue
    name = parts[1].strip()
    kind = parts[2].strip()
    payload = parts[3].strip() if len(parts) > 3 else ""
    unit = parts[4].strip() if len(parts) > 4 else ""
    recs[name] = (kind, payload, unit)

for name in names_in:
    kind, payload, unit = recs.get(name, ("missing", "", ""))
    if kind == "num":
        try:
            val = float(payload)
        except ValueError:
            val = None
        values.append(val)
        units.append(unit)
        texts.append(None)
        table.append("%s = %s %s" % (name, val, unit))
    elif kind == "text":
        values.append(None)
        units.append("")
        texts.append(payload)
        table.append("%s = %s" % (name, payload))
    elif kind == "missing":
        values.append(None)
        units.append("")
        texts.append(None)
        table.append("%s = <no record returned>" % name)
    else:
        values.append(None)
        units.append("")
        texts.append(None)
        table.append("%s = <not evaluable>" % name)

debug = "sent %d names, parsed %d records\n" % (len(names_in), len(recs)) + raw
# ---------- end nodemaple_materialproperties ----------
panel_6 = Panel(list_item_2)
panel_7 = Panel(panel_4)
panel_8 = Panel(tree_branch_4)
panel_9 = Panel(vl_profile)
panel_10 = Panel(nodemaple_materialproperties.values)
text_split = TextSplit(Text=nodemaple_materialproperties.table, Separators="=")  # -> simplify(Result)
nodemaple_steelprofileproperties = NODEMapleSteelProfileProperties(family=panel_6, section=panel_9, prop_names=panel_8)  # -> names_in, values, units, texts, table, debug; inputs prop_names: list
# ---------- nodemaple_steelprofileproperties: Python ----------
"""
NODEMaple Retrieve Section Properties
Fetches ALL section properties for a SINGLE section in one Maple process.

Mirrors NODEMaple Retrieve All Properties (materials), but targets
NODESteelProfiles_<family> modules.

Input:
  family        : family name, e.g. "I", "CF_RHS" (from families output)
  section       : section name, e.g. "IPE 200", "RHS 40 x 20 x 2"
  prop_names    : list of section property names (List Access!)
  maple_version : Maple year, e.g. "2026" (ignored if MAPLE env var is set)

Output:
  names_in : echo of the requested property names (ordered)
  values   : parallel list of numeric values (None for text properties)
  units    : parallel list of unit strings ("" where none)
  texts    : parallel list of text values (None for numeric properties)
  table    : display list, "name = value unit" one line per property
  debug    : raw Maple output, preceded by a send/receive summary
"""
import os
import subprocess

# ---------------------------------------------------------------------------
# Configuration
# ---------------------------------------------------------------------------
if os.environ.get("MAPLE"):
    MAPLE_ROOT = os.environ["MAPLE"]
else:
    MAPLE_ROOT = os.path.join(r"C:\Program Files", f"Maple {maple_version}")

MAPLE_PATH = os.path.join(MAPLE_ROOT, "bin.X86_64_WINDOWS", "cmaple.exe")

def run_maple_script(script, timeout=60):
    """Run a Maple script in a fresh cmaple process and return its output."""
    env = dict(os.environ)
    env["MAPLE"] = MAPLE_ROOT
    env["PATH"] = os.path.join(MAPLE_ROOT, "bin.X86_64_WINDOWS") + \
        os.pathsep + env.get("PATH", "")

    proc = subprocess.Popen(
        [MAPLE_PATH, "-q"],
        stdin=subprocess.PIPE, stdout=subprocess.PIPE,
        stderr=subprocess.STDOUT, text=True,
        cwd=os.path.join(MAPLE_ROOT, "bin.X86_64_WINDOWS"),
        env=env,
        creationflags=subprocess.CREATE_NO_WINDOW)

    try:
        out, _ = proc.communicate(input=script, timeout=timeout)
        return out
    except subprocess.TimeoutExpired:
        proc.kill()
        proc.communicate()
        raise RuntimeError("Maple timed out after %s s" % timeout)

# ---------------------------------------------------------------------------
# Main execution
# ---------------------------------------------------------------------------
family = str(family).strip()
module_name = "NODESteelProfiles_" + family
section = str(section).strip()

# Normalize the incoming names: trim whitespace and any surrounding quotes.
prop_list = []
for p in (prop_names if prop_names else []):
    s = str(p).strip().strip('"').strip("'")
    if s:
        prop_list.append(s)

# Build the Maple query line
query_line = f'pval := {module_name}:-Property("{section}", pname):'

# Quoted list literal — names contain commas (e.g. "W_el,y").
maple_list = "[" + ", ".join('"%s"' % p for p in prop_list) + "]"

# Protocol: ASCII "|" separator only, with try/catch for non-servable names.
script = (
    f'kernelopts(printbytes=false):\n'
    f'interface(prettyprint=0):\n'
    f'M := {module_name}:\n'
    f'sect := "{section}":\n'
    f'props := {maple_list}:\n'
    f'for i from 1 to numelems(props) do\n'
    f'  pname := props[i]:\n'
    f'  try\n'
    f'    pval := M:-Property(sect, pname):\n'
    f'  catch:\n'
    f'    printf("REC|%s|skip|\\n", pname):\n'
    f'    next;\n'
    f'  end try:\n'
    f'  if type(pval, string) then\n'
    f'    printf("REC|%s|text|%s\\n", pname, pval):\n'
    f'  else\n'
    f'    try\n'
    f'      q := Units:-Split(pval):\n'
    f'      printf("REC|%s|num|%a|%a\\n", pname, evalf(q[1]), q[2]):\n'
    f'    catch:\n'
    f'      try\n'
    f'        printf("REC|%s|num|%a|\\n", pname, evalf(pval)):\n'
    f'      catch:\n'
    f'        printf("REC|%s|skip|\\n", pname):\n'
    f'      end try:\n'
    f'    end try:\n'
    f'  end if:\n'
    f'end do:\n'
    f'quit:\n'
)

raw = run_maple_script(script)

# ---------------------------------------------------------------------------
# Parse results — output order follows the requested prop_list
# ---------------------------------------------------------------------------
names_in = list(prop_list)
values = []
units = []
texts = []
table = []

recs = {}
for line in raw.splitlines():
    s = line.strip()
    if not s.startswith("REC|"):
        continue
    parts = s.split("|")
    if len(parts) < 3:
        continue
    name = parts[1].strip()
    kind = parts[2].strip()
    payload = parts[3].strip() if len(parts) > 3 else ""
    unit = parts[4].strip() if len(parts) > 4 else ""
    recs[name] = (kind, payload, unit)

for name in names_in:
    kind, payload, unit = recs.get(name, ("missing", "", ""))
    if kind == "num":
        try:
            val = float(payload)
        except ValueError:
            val = None
        values.append(val)
        units.append(unit)
        texts.append(None)
        table.append("%s = %s %s" % (name, val, unit))
    elif kind == "text":
        values.append(None)
        units.append("")
        texts.append(payload)
        table.append("%s = %s" % (name, payload))
    elif kind == "missing":
        values.append(None)
        units.append("")
        texts.append(None)
        table.append("%s = <no record returned>" % name)
    else:
        values.append(None)
        units.append("")
        texts.append(None)
        table.append("%s = <not available>" % name)

debug = "sent %d names, parsed %d records\n" % (len(names_in), len(recs)) + raw
# ---------- end nodemaple_steelprofileproperties ----------
panel_11 = Panel(nodemaple_materialproperties.units)
vl_properties = ValueList({"strengthclass_CEN": "C35/45", "f_ck": "35.0 Units:-Unit(MPa)", "f_ck,cube": "45.0 Units:-Unit(MPa)"}, selected="f_ck")
text_trim = TextTrim(Text=text_split, Start=True, End=True)
panel_12 = Panel(nodemaple_steelprofileproperties.names_in)
list_item_3 = ListItem(List=text_trim, Index=1, Wrap=True)  # -> flatten(Item)

# ---- group: Value List Definitions Materials
populate_valuelist_3 = PopulateValueList(list_name="VL_material", names=nodemaple_materialdefinitions.categories)  # -> out, a; inputs list_name: String, names: list of String, values: list of String; same code as populate_valuelist
populate_valuelist_4 = PopulateValueList(list_name="VL_grade", names=panel_3, values=panel_3)  # -> out, a; inputs list_name: String, names: list of String, values: list of String; same code as populate_valuelist
populate_valuelist_5 = PopulateValueList(list_name="VL_properties", names=panel_4, values=list_item_3)  # -> out, a; inputs list_name: String, names: list of String, values: list of String; same code as populate_valuelist

# ----
panel_13 = Panel(nodemaple_materialproperties.texts)
panel_14 = Panel(nodemaple_steelprofileproperties.table)
panel_15 = Panel(nodemaple_steelprofileproperties.texts)
panel_16 = Panel(vl_properties)
panel_17 = Panel(nodemaple_materialproperties.table)
panel_18 = Panel(nodemaple_steelprofileproperties.values)
panel_19 = Panel(nodemaple_steelprofileproperties.units)
